# Grasshopper definition FiberwindingExample.gh (Grasshopper 1.0.7)
# plug-ins: Robots, GeoGrasshopper

number_slider = Slider(50, range=0..100)
curve = Curve(<curve referenced from the Rhino model>)
curve_2 = Curve(<curve referenced from the Rhino model>)
divide_curve = DivideCurve(Curve=curve, Count=number_slider, Kinks=False)  # -> Points, Tangents, Parameters
divide_curve_2 = DivideCurve(Curve=curve_2, Count=number_slider, Kinks=False)  # -> Points, Tangents, Parameters
panel = Panel("""0
0
1
1""")
weave = Weave(Pattern=panel, Stream0=divide_curve.Points, Stream1=divide_curve_2.Points, NullGaps=False)
index = Slider(70, range=0..100)
plane = Plane(weave)
point = Point(Point(-294.6346774, 392.1578581, 0))
point_2 = Point(Point(-616.9600397, -560.0576841, 0))
fiber_winder = FiberWinder(
    WeavingPlanes=plane,
    StartPoint=point,
    EndPoint=point_2,
    Index=index,
    PinSize=Slider(16, range=0..100),
    FiberMulti=0,
    BendingMulti=Slider(0.09, range=0..1),
    BendingDistance=Slider(0.6, range=0..1),
    MarkerSize=Slider(3, range=0..1000))  # -> StreamGeometry, StreamSettings, RobotPlanes
xy = XYPlane(Origin=fiber_winder.RobotPlanes)
pflip = FlipPlane(Plane=xy, ReverseX=False, ReverseY=False, SwapAxes=True)
pline = PolyLine(Vertices=pflip, Closed=False)
list = ValueList({"AA-KR60", "AA-KR30", "AA-KR60_KR30", "Fraese", "KMR150 R3300 Prime", "ITE-UR16e", "ITE-UR10", "ITE-UR5", "Staubli"}, selected="ITE-UR10")
list_2 = FlagFields({"Shoulder": 1, "Elbow": 2, "Wrist": 4}, selected=[])
target = CreateTarget(Plane=pflip, RobConf=list_2, IsCartesian=True)
load_robot = LoadRobotSystem(Name=list, Base=PlaneXY(0, 0, 0))
program = CreateProgram(Name="DefaultProgram", RobotSystem=load_robot, Targets1=target, StepSize=1)  # -> Program, Code, Duration, Warnings, Errors, Arrays
panel_2 = Panel(program.Errors)
knob = ControlKnob(Decimals=2, Limit=True, Maximum=1, Minimum=0, Range=1, Value=0.28)
sim = ProgramSimulation(Program=program.Program, Time=knob, Normalized=True)  # -> SystemMeshes, JointRotations, Plane, Index, Time, Program, Errors
