# Grasshopper definition geostreamer2.gh (Grasshopper 1.0.7)
# plug-ins: GeoGrasshopper

number_slider = Slider(20, range=0..100)
crv = Curve(<curve referenced from the Rhino model>)
crv_2 = Curve(<curve referenced from the Rhino model>)
series = Series(Start=0, Step=expr("1/x", number_slider), Count=expr("x+1", number_slider))
tweencrv = TweenCurve(CurveA=crv, CurveB=crv_2, Factor=series, BlendType=0)
pipe = Pipe(Curve=tweencrv, Radius=Slider(39, range=1..100), Caps=0)
mesh = MeshBrep(
    Brep=pipe,
    Settings={GridMaxCount=0, GridMinCount=16, JaggedSeams=False, MaxEdgeLength=0, MinEdgeLength=0.0001, MinTolerance=0, Refine=True, RefineAngle=0, RelativeTolerance=0.65, SimplePlanes=True, Tolerance=0})  # -> flatten(Mesh)
brep = Brep(<brep referenced from the Rhino model>)
update = Button()
gs_settings = StreamSettings()
panel = Panel(" 127.0.0.1")
mesh_2 = MeshBrep(
    Brep=brep,
    Settings={GridMaxCount=0, GridMinCount=16, JaggedSeams=False, MaxEdgeLength=0, MinEdgeLength=0.0001, MinTolerance=0, Refine=True, RefineAngle=0, RelativeTolerance=0.65, SimplePlanes=False, Tolerance=0})
crv_3 = Curve([<curve referenced from the Rhino model> x2])
geostream = GeometryStreamer(
    IpAdress="127.0.0.1",
    Connect=Toggle(True),
    UpdateDebug=update,
    Meshes=[mesh, mesh_2],
    Curves=crv_3,
    Settings=gs_settings)  # -> IpAdress, Debug
panel_2 = Panel(geostream.Debug)
